% Simulink data dictionary rev3_data.sldd

MC_DC_State = enum(DefaultValue="Disabled")
  Disabled = 0
  Enabled = 1
  Speed_Check = 2
  Active = 3
  Complete = 4

MC_VSM_State = enum(DefaultValue="Start")
  Start = 0
  PC_Init = 1
  PC_Active = 2
  PC_Finish = 3
  Wait = 4
  Ready = 5
  Motor_Running = 6
  Fault = 7
  Shutdown = 14
  Recycle_Power = 15

BMS_Contactor_Command = enum(DefaultValue="Open_Contactor")
  Open_Contactor = 0
  Close_Contactor = 1
  Stay = 2

UC_State = enum(DefaultValue="Preset")
  Preset = 0
  Key_Cycle = 1
  MC_Off = 2
  LVSS_MC_Startup = 3
  MC_Init = 4
  Contactor_Closed = 5
  MC_Ready = 6
  Contactor_Open = 7
  MC_Discharging = 8
  LVSS_MC_Shutdown = 9
  MC_Active = 10
  Estop = 11
  Fault = 12
  Super_Fault = 13

CAN = Simulink.Bus()
  Inverter_DC: boolean
  Inverter_EN: boolean
  BMS_Contactor: Enum: BMS_Contactor_Command
  MC_PS: uint8
  Batt_PS: uint8
  HIB_EN: boolean
  HUDL_EN: boolean
  TMS_EN: boolean
  GUB_EN: boolean
  Acc_EN: boolean
  Batt_12V_EN: boolean
  Torque: int16
  Direction_Command: int16
  Rolling_Counter: int16
  Speed_Command: int16
  Speed_Mode_Enable: int16
  Torque_Limit_Command: int16